# Grasshopper definition AAT_Facade_Solar_Benefit_Study_Optimisation.gh (Grasshopper 1.0.7)
# plug-ins: LunchBox, SelectablePreview

crv = Curve(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)
brep = Brep([<brep referenced from the Rhino model> x3])
debrep = DeconstructBrep(Brep=brep)  # -> Faces, Edges, Vertices
selpv = SelectablePreview(Geometry=debrep.Faces, lock=True, maintain=False, order=False, selectedobject="14|15|8|9|2|3")  # -> Geometry, Path, Index
cull_i = CullIndex(List=debrep.Faces, Indices=selpv.Index, Wrap=True)
item = ListItem(List=debrep.Faces, Index=[Slider(2, range=0..10), Slider(3, range=0..10)], Wrap=True)

# ----
# EXAMPLE 1
number_slider = Slider(4, range=0..10)
number_slider_2 = Slider(5, range=0..100)
series = Series(Start=0, Step=number_slider, Count=number_slider_2)
Z = UnitZ(Factor=series)
# PARAMETRISED MODEL / EXAMPLES
move = Move(Geometry=crv, Motion=Z)  # -> Geometry, Transform
genes = GenePool(Decimals=1, Maximum=20, Minimum=0, Value=[11.1, 15.5, 13, 15, 20])
number_slider_3 = Slider(3, range=0..10)
explode = Explode(Curve=move.Geometry, Recursive=True)  # -> Segments, Vertices
neg = Negative(Value=genes)  # -> graft(Result)
item_2 = ListItem(List=explode.Segments, Index=number_slider_3, Wrap=True)
item_3 = ListItem(List=explode.Vertices, Index=number_slider_3, Wrap=True)  # -> Item, Item1, Item2, Item3, Item4
amp = Amplitude(Vector=item_2, Amplitude=neg)
move_2 = Move(Geometry=item_3.Item, Motion=amp)  # -> Geometry, Transform
Z_2 = UnitZ(Factor=number_slider)
pline = PolyLine(Vertices=[move_2.Geometry, item_3.Item1, item_3.Item3, item_3.Item4], Closed=True)
extr = Extrude(Base=pline, Direction=Z_2)
cap = CapHoles(Brep=extr)
debrep_2 = DeconstructBrep(Brep=cap)  # -> Faces, Edges, Vertices
item_4 = ListItem(List=debrep_2.Faces, Index="0", Wrap=True)
cull_i_2 = CullIndex(List=debrep_2.Faces, Indices="0", Wrap=True)

# ----
# EXAMPLE 3
multiplication = Multiplication(A=number_slider, B=number_slider_2)
Z_3 = UnitZ(Factor=multiplication)
extr_2 = Extrude(Base=crv, Direction=Z_3)
cap_2 = CapHoles(Brep=extr_2)
brep_2 = Brep(cap_2)
debrep_3 = DeconstructBrep(Brep=brep_2)  # -> Faces, Edges, Vertices
item_5 = ListItem(List=debrep_3.Edges, Index="10", Wrap=True)  # -> Item, Item1
number_slider_4 = Slider(5, range=0..10)
divide = DivideCurve(Curve=item_5.Item, Count=number_slider_4, Kinks=False)  # -> Points, Tangents, Parameters
divide_2 = DivideCurve(Curve=item_5.Item1, Count=number_slider_4, Kinks=False)  # -> Points, Tangents, Parameters
md_slider = MDSlider(SliderMode=0, slider_value=Point(0.5, 0.5, 0.5), x_domain=Domain(0, 1), y_domain=Domain(0, 1), z_domain=Domain(0, 1))
item_6 = ListItem(List=debrep_3.Faces, Index=0, Wrap=True)  # -> Item, Item1, Item2, Item3
ln = Line(StartPoint=divide.Points, EndPoint=divide_2.Points)
evalsrf = EvaluateSurface(Surface=item_6.Item3, Point=md_slider)  # -> Point, Normal, UDirection, VDirection, Frame
divide_3 = DivideCurve(Curve=ln, Count=Slider(7, range=0..10), Kinks=False)  # -> Points, Tangents, Parameters
item_7 = ListItem(List=divide_3.Points, Index=0, Wrap=True)  # -> Item, Item1, Item2, Item3, Item4, Item5, Item6, Item7
genes_2 = GenePool(Decimals=0, Maximum=200, Minimum=0, Value=[6, 154, 108, 118, 180, 22])
dom = ConstructDomain(DomainStart=Slider(1, range=0..1), DomainEnd=Slider(4.6, range=4..8))
random = Random(Range=dom, Number=Slider(6, range=0..10), Seed=genes_2)
amp_2 = Amplitude(Vector=evalsrf.Normal, Amplitude=random)
panel = Panel(random)
move_3 = Move(Geometry=[item_7.Item1, item_7.Item2, item_7.Item3, item_7.Item4, item_7.Item5, item_7.Item6], Motion=amp_2)  # -> Geometry, Transform
intcrv = Interpolate(Vertices=[item_7.Item, move_3.Geometry, item_7.Item7], Degree=3, Periodic=False, KnotStyle=1)  # -> simplify(Curve), Length, Domain
loft = Loft(
    Curves=flatten(intcrv.Curve),
    Options={Adjust=False, Closed=False, LoftEnds=0, LoftSimp=0, LoftType=0, Rebuild=10, Refit=0.01})
item_8 = ListItem(List=flatten(intcrv.Curve), Index=0, Wrap=True)
end = EndPoints(Curve=item_8)  # -> Start, End
flip = Flip(Surface=loft)  # -> Surface, Result
ln_2 = Line(StartPoint=end.Start, EndPoint=end.End)
join = JoinCurves(Curves=flatten([ln_2, item_8]), Preserve=False)
trib = TrianglePanelsB(Surface=flip.Surface, UDivisions=Slider(20, range=0..100), VDivisions=Slider(30, range=0..100))
join_2 = BrepJoin(Breps=trib)  # -> Breps, Closed
smesh = SimpleMesh(Brep=join_2.Breps)
boundary = BoundarySurfaces(Edges=join)

# ----
# EXAMPLE 2
Z_4 = UnitZ(Factor=number_slider)
extr_3 = Extrude(Base=move.Geometry, Direction=Z_4)
debrep_4 = DeconstructBrep(Brep=extr_3)  # -> Faces, Edges, Vertices
item_9 = ListItem(List=debrep_4.Faces, Index="3", Wrap=True)
number_slider_5 = Slider(3, range=1..4)
quads = QuadPanels(Surface=item_9, UDivisions=Slider(2, range=0..10), VDivisions=Slider(15, range=0..100))
dom_2 = ConstructDomain(DomainStart=Slider(0, range=0..100), DomainEnd=number_slider_5)
genes_3 = GenePool(Decimals=0, Maximum=100, Minimum=0, Value=[59, 91, 2, 11])
tstat = TreeStatistics(Tree=quads)  # -> Paths, Length, Count
md_slider_2 = MDSlider(SliderMode=0, slider_value=Point(0.5, 0.5, 0.5), x_domain=Domain(0, 1), y_domain=Domain(0, 1), z_domain=Domain(0, 1))
random_2 = Random(Range=dom_2, Number=tstat.Length, Seed=genes_3)
evalsrf_2 = EvaluateSurface(Surface=reparameterize(quads), Point=md_slider_2)  # -> Point, Normal, UDirection, VDirection, Frame
neg_2 = Negative(Value=random_2)
amp_3 = Amplitude(Vector=evalsrf_2.Normal, Amplitude=neg_2)
extr_4 = Extrude(Base=quads, Direction=amp_3)
debrep_5 = DeconstructBrep(Brep=extr_4)  # -> Faces, Edges, Vertices
item_10 = ListItem(List=debrep_5.Faces, Index="5", Wrap=True)
cull_i_3 = CullIndex(List=debrep_5.Faces, Indices="5", Wrap=True)
smesh_2 = SimpleMesh(Brep=item_10)

facade_geometries = Geometry(item_4)
rest_of_the_building = Geometry(cull_i_2)

rest_of_the_building_2 = Brep([cull_i_3, extr_3])
facade_geometries_2 = Geometry(smesh_2)

# ----
# x
rest_of_the_building_3 = Brep([cap_2, boundary])
facade_geometries_3 = Geometry(smesh)

# ----
# x
toggle = BooleanToggle(False)

# ----
# If the link below doesn't work
# (it needs internet)
# you can use a EPW file saved
# in your computer.
# 
# Right click - Select one existing file
# 
# Connect it to the ImportEPW component
# IMPORT EPW
panel_2 = Panel("https://energyplus-weather.s3.amazonaws.com/southwest_pacific_wmo_region_5/AUS/AUS_SA.Adelaide-Kent.Town.946750_RMY/AUS_SA.Adelaide-Kent.Town.946750_RMY.zip")
downloadepw = LBDownloadWeather(weather_URL=panel_2)  # -> epw_file, stat_file, ddy_file; plug-in component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
epw_file = FilePath()
importepw = LBImportEPW(epw_file=downloadepw.epw_file)  # -> location, dry_bulb_temperature, dew_point_temperature, relative_humidity, wind_speed, wind_direction, direct_normal_rad, diffuse_horizontal_rad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; plug-in component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

# ----
# SOLAR BENEFIT ANALYSIS / RADIATION ANALYSIS
epwmap = LBEPWmap(epw_map=toggle)  # -> report; plug-in component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

# ----
# You can change the analysis period
# to simulate summer and winter
# separately
number_slider_6 = Slider(12, range=1..12)
analysisperiod = LBAnalysisPeriod(start_month=Slider(1, range=1..12), start_day=1, start_hour=0, end_month=number_slider_6)  # -> period, hoys, dates; plug-in component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

# ----
# SUNPATH
site = Curve(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)
area = Area(Geometry=site)  # -> Area, Centroid
sunpath = LBSunPath(location=importepw.location, hoys=analysisperiod.hoys, center_pt=area.Centroid, scale=1)  # -> report, vectors, altitudes, azimuths, hoys, sun_pts, analemma, daily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; plug-in component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
preview = CustomPreview(Geometry=[sunpath.analemma, sunpath.compass, sunpath.daily], Material=ColourSwatch(SwatchColor=RGB(0, 0, 0)))

# ----
# SKY MATRIX FOR
# SOLAR BENEFIT
# ANALYSIS
panel_3 = Panel("18")
benefitmatrix = LBBenefitSkyMatrix(
    location=importepw.location,
    temperature=importepw.dry_bulb_temperature,
    bal_temp=panel_3,
    direct_rad=importepw.direct_normal_rad,
    diffuse_rad=importepw.diffuse_horizontal_rad,
    hoys=analysisperiod.hoys)  # -> report, sky_mtx; plug-in component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

# ----
# SKY MATRIX FOR
# RADIATION ANALYSIS
skymatrix = LBCumulativeSkyMatrix(
    location=importepw.location,
    direct_rad=importepw.direct_normal_rad,
    diffuse_rad=importepw.diffuse_horizontal_rad,
    hoys=analysisperiod.hoys)  # -> report, sky_mtx; plug-in component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

# ----
# Connect the sky matrix
# according to the simulation
# that you want to run.
# 
# Radiation analysis or
# Solar benefit analysis
sky_matrix = Data(benefitmatrix.sky_mtx)

contextbuildings = Geometry([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])

# ----
# 1
# Connect here the
# facade geometries
# to be analysed
# 2
# Connect here the
# rest of the building
building_geometries = Geometry(cull_i)
# SET GEOMETRIES
facade_geometry = Geometry(selpv.Geometry)

wires = BrepWireframe(Brep=building_geometries, Density=-1)

# ----
# 3
# Set it to True to
# run the simulation
toggle_2 = BooleanToggle(False)

# ----
# SOLAR BENEFIT / RADIATION ANALYSIS
incidentradiation = LBIncidentRadiation(
    sky_mtx=sky_matrix,
    geometry=flatten(facade_geometry),
    context=flatten([contextbuildings, building_geometries]),
    grid_size=Slider(1, range=0..1),
    offset_dist=Slider(0.15, range=0..1),
    run=toggle_2)  # -> report, points, results, total, mesh, legend, title, int_mtx; plug-in component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

preview_2 = CustomPreview(Geometry=wires, Material=ColourSwatch(SwatchColor=RGB(0, 0, 0)))
# x
ma = MassAddition(Input=incidentradiation.results)  # -> Result, PartialResults

neg_3 = Negative(Value=Slider(100, range=0..1000))
larger = LargerThan(FirstNumber=incidentradiation.results, SecondNumber=neg_3)  # -> LargerThan, OrEqualTo
# x
number_slider_7 = Slider(0.9, range=0..1)
cull = CullPattern(List=incidentradiation.results, CullPattern=larger.LargerThan)
cullf = CullFaces(Mesh=incidentradiation.mesh, Pattern=invert(larger.LargerThan))
cullf_2 = CullFaces(Mesh=incidentradiation.mesh, Pattern=larger.LargerThan)
dom_3 = ConstructDomain(DomainStart=Slider(0.2, range=0..1), DomainEnd=number_slider_7)
bnd = Bounds(Numbers=cull)
faceb = FaceBoundaries(Mesh=cullf)
remap = RemapNumbers(Value=cull, Source=bnd, Target=dom_3)  # -> Mapped, Clipped
area_2 = Area(Geometry=faceb)  # -> Area, Centroid
scale = Scale(Geometry=faceb, Center=area_2.Centroid, Factor=remap.Mapped)  # -> Geometry, Transform
faceb_2 = FaceBoundaries(Mesh=cullf_2)
boundary_2 = BoundarySurfaces(Edges=faceb_2)
boundary_3 = BoundarySurfaces(Edges=[faceb, scale.Geometry])

int = Integer(ma.Result)
net_solar_benefit = Panel(int)

# ----
# OPTIMISATION
# Connect the genome
# to the sliders that can
# be changed to optimise
# your design.
galapagos = Galapagos(fitness=ma, gene=[genes_3, number_slider_5])

wires_2 = BrepWireframe(Brep=[boundary_3, boundary_2], Density=-1)
preview_3 = CustomPreview(Geometry=wires_2, Material=ColourSwatch(SwatchColor=RGB(0, 0, 0)))
