# Grasshopper definition AAT_Thermal_Comfort_Daylight_00.gh (Grasshopper 1.0.7)
# plug-ins: ItemSelector

# ----
# CREATE YOUR OWN CONSTRUCTION SET
# MATERIALS FROM LIBRARY
panel = Panel("plaster")
searchmats = HBSearchMaterials(keywords=panel)  # -> opaque_mats, window_mats; plug-in component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
searchmats_2 = HBSearchMaterials(keywords="concrete")  # -> opaque_mats, window_mats; plug-in component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
searchmats_3 = HBSearchMaterials(keywords="insulation")  # -> opaque_mats, window_mats; plug-in component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
searchmats_4 = HBSearchMaterials(keywords="AIR")  # -> opaque_mats, window_mats; plug-in component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
searchmats_5 = HBSearchMaterials(keywords="concrete")  # -> opaque_mats, window_mats; plug-in component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
searchmats_6 = HBSearchMaterials(keywords="metal")  # -> opaque_mats, window_mats; plug-in component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
searchmats_7 = HBSearchMaterials(keywords="insulation")  # -> opaque_mats, window_mats; plug-in component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
searchmats_8 = HBSearchMaterials(keywords="brick")  # -> opaque_mats, window_mats; plug-in component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
vegetationmat = HBVegetationMaterial()  # -> mat; plug-in component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
list = Honeybee_ItemSelector(
    searchmats_5.opaque_mats,
    {"100mm Normalweight concrete floor", "12 in. Normalweight Concrete Floor", "4 in. Normalweight Concrete Floor", "4 in. Normalweight Concrete Wall", "6 in. Heavyweight Concrete Roof", "6 in. Normalweight Concrete Floor", "8 in. Concrete Block Basement Wall", "8 in. Concrete Block Wall", "8 in. Normalweight Concrete Floor", "8 in. Normalweight Concrete Wall", "8IN CONCRETE HW RefBldg", "8IN Concrete HW", "Concrete Pavement", "Generic HW Concrete", "Generic LW Concrete", "HW CONCRETE", "HW CONCRETE 8 in", "M11 100mm lightweight concrete", "M15 200mm heavyweight concrete", "MAT-CC05 4 HW CONCRETE", "MAT-CC05 8 HW CONCRETE", "NACM_Concrete 4in_140lb/ft3"}, selected="M15 200mm heavyweight concrete")
list_2 = Honeybee_ItemSelector(
    searchmats_6.opaque_mats,
    {"F08 Metal surface", "Generic Painted Metal", "Metal Building Semi-Cond Wall Insulation-0.54", "Metal Building Wall Insulation R-4.14 IP", "Metal Decking", "Metal Roof Insulation R-5.21 IP", "Metal Roof Surface", "Metal Roof Surface - Highly Reflective", "Metal Roofing", "Metal Roofing - Highly Reflective", "Metal Semi-Cond Roof Insulation-1.05", "Metal Siding", "Metal Standing Seam - 1/16 in. CBES", "Metal Surface"}, selected="Metal Siding")
list_3 = Honeybee_ItemSelector(
    searchmats_7.opaque_mats,
    {"AtticFloor Insulation", "Generic 25mm Insulation", "Generic 50mm Insulation", "I01 25mm insulation board", "I02 50mm insulation board", "IEAD NonRes Roof Insulation-1.76", "IEAD Roof Insulation R-3.47 IP", "Insulation 1m", "Mass NonRes Wall Insulation-0.43", "Mass Wall Insulation R-4.23 IP"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}, selected="Typical Insulation-R10")
list_4 = Honeybee_ItemSelector(searchmats_8.opaque_mats, {"Generic Brick", "M01 100mm brick"}, selected="M01 100mm brick")
list_5 = Honeybee_ItemSelector(
    searchmats_2.opaque_mats,
    {"100mm Normalweight concrete floor", "12 in. Normalweight Concrete Floor", "4 in. Normalweight Concrete Floor", "4 in. Normalweight Concrete Wall", "6 in. Heavyweight Concrete Roof", "6 in. Normalweight Concrete Floor", "8 in. Concrete Block Basement Wall", "8 in. Concrete Block Wall", "8 in. Normalweight Concrete Floor", "8 in. Normalweight Concrete Wall", "8IN CONCRETE HW RefBldg", "8IN Concrete HW", "Concrete Pavement", "Generic HW Concrete", "Generic LW Concrete", "HW CONCRETE", "HW CONCRETE 8 in", "M11 100mm lightweight concrete", "M15 200mm heavyweight concrete", "MAT-CC05 4 HW CONCRETE", "MAT-CC05 8 HW CONCRETE", "NACM_Concrete 4in_140lb/ft3"}, selected="M11 100mm lightweight concrete")
list_6 = Honeybee_ItemSelector(
    searchmats_3.opaque_mats,
    {"AtticFloor Insulation", "Generic 25mm Insulation", "Generic 50mm Insulation", "I01 25mm insulation board", "I02 50mm insulation board", "IEAD NonRes Roof Insulation-1.76", "IEAD Roof Insulation R-3.47 IP", "Insulation 1m", "Mass NonRes Wall Insulation-0.43", "Mass Wall Insulation R-4.23 IP"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}, selected="Typical Insulation-R12")
list_7 = Honeybee_ItemSelector(
    searchmats_4.opaque_mats,
    {"F04 Wall air space resistance", "F05 Ceiling air space resistance", "Generic Ceiling Air Gap", "Generic Wall Air Gap", "Typical Air Wall"}, selected="Generic Wall Air Gap")
list_8 = Honeybee_ItemSelector(searchmats.opaque_mats, {"Gypsum Or Plaster Board - 3/8 in."}, selected="Gypsum Or Plaster Board - 3/8 in.")
merge = Merge(Data1=vegetationmat, Data2=list)
merge_2 = Merge(Data1=list_2, Data2=list_3, Data3=list_4)
merge_3 = Merge(Data1=list_5, Data2=list_6, Data3=list_7, Data4=list_8)
opaqueconstr = HBOpaqueConstruction(name="ceiling", materials=merge_3)  # -> constr; plug-in component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
decnstrconstr = HBDeconstructConstruction(constr=opaqueconstr)  # -> materials, layers, r_val_si, r_val_ip, u_fac_si, u_fac_ip, shgc, t_sol, t_vis; plug-in component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
opaqueconstr_2 = HBOpaqueConstruction(name="Interior floor", materials=reverse(decnstrconstr.materials))  # -> constr; plug-in component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
opaqueconstr_3 = HBOpaqueConstruction(name="Green Roof", materials=merge)  # -> constr; plug-in component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
opaqueconstr_4 = HBOpaqueConstruction(name="external wall", materials=merge_2)  # -> constr; plug-in component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

# ----
# EXTERNAL WALLS
panel_2 = Panel("wall")
searchconstrs = HBSearchConstructions(keywords=panel_2)  # -> opaque_constrs, window_constrs, shade_constrs; plug-in component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
list_9 = Honeybee_ItemSelector(
    searchconstrs.opaque_constrs,
    {"Adiabatic Wall", "Generic Exterior Wall", "Generic Interior Wall", "Generic Underground Wall", "Typical Insulated Basement Mass Wall", "Typical Insulated Basement Mass Wall-R10"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}, selected="Typical Insulated Exterior Mass Wall-R22")

# ----
# ROOF
panel_3 = Panel("roof")
searchconstrs_2 = HBSearchConstructions(keywords=panel_3)  # -> opaque_constrs, window_constrs, shade_constrs; plug-in component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
list_10 = Honeybee_ItemSelector(
    searchconstrs_2.opaque_constrs,
    {"Adiabatic Roof", "Generic Roof", "Generic Underground Roof", "Typical Built Up Roof", "Typical Built Up Roof - Highly Reflective", "Typical IEAD Roof", "Typical IEAD Roof - Highly Reflective", "Typical IEAD Roof - Highly Reflective-R16", "Typical IEAD Roof - Highly Reflective-R21", "Typical IEAD Roof - Highly Reflective-R26"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}, selected="Typical IEAD Roof - Highly Reflective-R26")

# ----
# EXPOSED FLOOR
panel_4 = Panel("floor")
searchconstrs_3 = HBSearchConstructions(keywords=panel_4)  # -> opaque_constrs, window_constrs, shade_constrs; plug-in component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
list_11 = Honeybee_ItemSelector(
    searchconstrs_3.opaque_constrs,
    {"Adiabatic ExteriorFloor", "Adiabatic GroundContactFloor", "Generic Exposed Floor", "Generic Interior Floor", "Typical Attic Floor", "Typical Carpeted 4in Slab Floor", "Typical Carpeted 6in Slab Floor", "Typical Carpeted 8in Slab Floor", "Typical Insulated 6in Slab Floor", "Typical Insulated 8in Slab Floor"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}, selected="Typical Insulated Exterior Mass Floor-R24")

# ----
# GROUND FLOOR
panel_5 = Panel("SLAB")
searchconstrs_4 = HBSearchConstructions(keywords=panel_5)  # -> opaque_constrs, window_constrs, shade_constrs; plug-in component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
list_12 = Honeybee_ItemSelector(
    searchconstrs_4.opaque_constrs,
    {"Generic Ground Slab", "Typical Carpeted 4in Slab Floor", "Typical Carpeted 6in Slab Floor", "Typical Carpeted 8in Slab Floor", "Typical Insulated 6in Slab Floor", "Typical Insulated 8in Slab Floor", "Typical Insulated Carpeted 4in Slab Floor", "Typical Insulated Carpeted 6in Slab Floor", "Typical Insulated Carpeted 6in Slab Floor-R5", "Typical Insulated Carpeted 8in Slab Floor", "Typical Insulated Carpeted 8in Slab Floor-R10", "Typical Insulated Carpeted 8in Slab Floor-R5", "Typical Interior Slab Floor", "Typical Uncarpeted 4in Slab Floor", "Typical Uncarpeted 6in Slab Floor", "Typical Uninsulated 6in Slab Floor", "Typical Uninsulated 8in Slab Floor", "Typical Uninsulated Carpeted 8in Slab Floor", "Typical Unisulated Carpeted 6in Slab Floor", "ext-slab", "ext-slab-mass", "ext-slab-metal-building", "ext-slab-steel-frame"}, selected="Typical Uninsulated 8in Slab Floor")

# ----
# INTERIOR WALL
panel_6 = Panel("wall")
searchconstrs_5 = HBSearchConstructions(keywords=panel_6)  # -> opaque_constrs, window_constrs, shade_constrs; plug-in component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
list_13 = Honeybee_ItemSelector(
    searchconstrs_5.opaque_constrs,
    {"Adiabatic Wall", "Generic Exterior Wall", "Generic Interior Wall", "Generic Underground Wall", "Typical Insulated Basement Mass Wall", "Typical Insulated Basement Mass Wall-R10"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}, selected="Generic Interior Wall")

# ----
# CEILING / INTERIOR FLOOR
panel_7 = Panel("ceiling")
searchconstrs_6 = HBSearchConstructions(keywords=panel_7)  # -> opaque_constrs, window_constrs, shade_constrs; plug-in component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
list_14 = Honeybee_ItemSelector(
    searchconstrs_6.opaque_constrs,
    {"Generic Interior Ceiling", "Typical Insulated Exterior Mass Floor Ceiling", "Typical Interior Ceiling", "Typical Wood Joist Attic Floor Ceiling"}, selected="Generic Interior Ceiling")

# ----
# WINDOW
panel_8 = Panel("dbl")
searchconstrs_7 = HBSearchConstructions(keywords=panel_8)  # -> opaque_constrs, window_constrs, shade_constrs; plug-in component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
list_15 = Honeybee_ItemSelector(
    searchconstrs_7.window_constrs,
    {"U 0.24 SHGC 0.11 Dbl LoE Elec Abs Colored 6mm/13mm Arg", "U 0.24 SHGC 0.16 Dbl Elec Abs Colored 6mm/13mm Arg", "U 0.24 SHGC 0.23 Dbl LoE Spec Sel Tint 6mm/13mm Arg", "U 0.25 SHGC 0.40 Dbl LoE (e2-.1) Tint 6mm/13mm Arg", "U 0.29 SHGC 0.11 Dbl LoE Elec Ref Colored 6mm/13mm Air", "U 0.29 SHGC 0.17 Dbl Elec Abs Colored 6mm/13mm Air", "U 0.30 SHGC 0.40 Dbl LoE (e2-.1) Tint 6mm/13mm Air", "U 0.33 SHGC 0.11 Dbl LoE Elec Ref Colored 6mm/13mm Air", "U 0.33 SHGC 0.40 Dbl LoE (e2-.1) Tint 6mm/13mm Air", "U 0.34 SHGC 0.40 Dbl LoE (e2-.1) Tint 6mm/13mm Air"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}, selected="U 0.56 SHGC 0.76 Dbl Clr 3mm/6mm Air")

# ----
# CONSTRUCTION SETS FROM LIBRARY
decnstrconstr_2 = HBDeconstructConstruction(constr=list_14)  # -> materials, layers, r_val_si, r_val_ip, u_fac_si, u_fac_ip, shgc, t_sol, t_vis; plug-in component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
opaqueconstr_5 = HBOpaqueConstruction(name="Interior floor", materials=reverse(decnstrconstr_2.materials))  # -> constr; plug-in component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

# ----
# CONSTRUCTION SET CHECKER
# Use this group to check
# construction set materials,
# R-Value and U-Value.
# Connect here the construction set
# that you want to check
decnstrconstr_3 = HBDeconstructConstruction(constr=list_10)  # -> materials, layers, r_val_si, r_val_ip, u_fac_si, u_fac_ip, shgc, t_sol, t_vis; plug-in component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
panel_9 = Panel(decnstrconstr_3.r_val_si)
panel_10 = Panel(decnstrconstr_3.u_fac_si)
panel_11 = Panel(decnstrconstr_3.materials)

# ----
# 1
# REFERENCE HERE ALL
# THE BREPS - THERMAL ZONES
# CREATED IN RHINO
brep = Brep([<brep referenced from the Rhino model> x13])

# ----
# 2
# APPLY CONSTRUCTION SETS
interiorsubset = HBInteriorConstructionSubset(interior_wall=list_13, ceiling=list_14, interior_floor=opaqueconstr_5)  # -> interior_set; plug-in component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
exteriorsubset = HBExteriorConstructionSubset(exterior_wall=list_9, exterior_roof=list_10, exposed_floor=list_11)  # -> exterior_set; plug-in component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
groundsubset = HBGroundConstructionSubset(ground_floor=list_12)  # -> ground_set; plug-in component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

# ----
# ANALYSED FLOOR PROGRAM
bldgprograms = HBBuildingPrograms({"LargeOffice", "MediumOffice", "SmallOffice", "MidriseApartment", "HighriseApartment", "Retail", "StripMall", "PrimarySchool", "SecondarySchool", "SmallHotel", "LargeHotel", "Hospital", "Outpatient", "Laboratory", "Warehouse", "SuperMarket", "FullServiceRestaurant", "QuickServiceRestaurant", "Courthouse", "LargeDataCenterHighITE", "LargeDataCenterLowITE", "SmallDataCenterHighITE", "SmallDataCenterLowITE"}, selected="MediumOffice")

# ----
# PREPARE THE MODEL
intsolid = HBIntersectSolids(solids=flatten(brep), run=Toggle(True))  # -> int_solids; plug-in component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
constructionset = HBConstructionSet(exterior_subset=exteriorsubset, ground_subset=groundsubset, interior_subset=interiorsubset)  # -> constr_set; plug-in component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

# ----
# CONDITIONED/
# NOT CONDITIONED
toggle = BooleanToggle(True)

roomsolid = HBRoomFromSolid(geo=flatten(intsolid), constr_set=constructionset, program=bldgprograms, conditioned=toggle)  # -> report, rooms; plug-in component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

# ----
# Adjust according to
# your shading material
number_slider = Slider(0.6, range=0..1)

solveadj = HBSolveAdjacency(rooms=flatten(roomsolid.rooms), ep_int_constr=interiorsubset, run="1")  # -> report, adj_rooms; plug-in component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
shadeconstr = HBShadeConstruction(name="Shading material", sol_ref=number_slider, vis_ref=Slider(0.6, range=0..1))  # -> constr; plug-in component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

# ----
# SURROUNDING
# BUILDINGS
buildings = Geometry([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])
shade = HBShade(geo=buildings)  # -> report, shades; plug-in component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

# ----
# 4
# REFERENCE HERE ALL
# THE SHADING SURFACES
# FROM RHINO
brep_2 = Brep([<brep referenced from the Rhino model> x34])

# ----
# 3
# REFERENCE HERE ALL
# THE WINDOWS SURFACES
# FROM RHINO
srf = Surface([<surface referenced from the Rhino model> x27])

# ----
# NOT-CONDITIONED
# NATURAL VENTILATION
panel_12 = Panel("32")
ventcontrol = HBVentilationControl(min_in_temp="15", min_out_temp="15", max_out_temp=panel_12)  # -> vent_cntrl; plug-in component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

# ----
# CONDITIONED
# NATURAL VENTILATION
# HEATING
# & COOLING
# 
# SETPOINTS
panel_14 = Panel("18")
ventcontrol_2 = HBVentilationControl(min_in_temp=panel_14, max_in_temp="25")  # -> vent_cntrl; plug-in component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

aperture = HBAperture(geo=srf, operable=Toggle(True), ep_constr=list_15)  # -> report, apertures; plug-in component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
shade_2 = HBShade(geo=brep_2, ep_constr=shadeconstr)  # -> report, shades; plug-in component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
addsubface = HBAddSubface(hb_obj=flatten(solveadj.adj_rooms), sub_faces=flatten(aperture.apertures))  # -> hb_obj; plug-in component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
python = GhPythonScript(x=ventcontrol_2, y=ventcontrol, z=toggle)  # -> out, a
# ---------- python: Python ----------
__author__ = "Juliana Croffi"
__version__ = "2023.04.05"

import rhinoscriptsyntax as rs

if z == True:
     a = x
     
else:
    a = y
# ---------- end python ----------
windowopen = HBWindowOpening(rooms=flatten(addsubface), vent_cntrl=python.a)  # -> report, rooms; plug-in component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
applysetpointvals = HBApplySetpointValues(room_or_program=flatten(windowopen.rooms), cooling_setpt="25", heating_setpt=panel_14)  # -> report, mod_obj; plug-in component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
floorheight = HBRoomsByFloorHeight(rooms=flatten(applysetpointvals.mod_obj))  # -> flr_hgts, simplify(rooms); plug-in component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
tstat = TreeStatistics(Tree=floorheight.rooms)  # -> Paths, Length, Count
sort = SortList(Keys=tstat.Length, ValuesA=tstat.Paths)  # -> Keys, reverse(ValuesA)
item = ListItem(List=sort.ValuesA, Index=0, Wrap=True)
branch = TreeBranch(Tree=floorheight.rooms, Path=item, MaintainPaths=True)
model = HBModel(rooms=flatten(floorheight.rooms), shades=flatten([shade.shades, shade_2.shades]))  # -> report, model; plug-in component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
gridrooms = HBSensorGridFromRooms(rooms=branch, grid_size=Slider(0.5, range=0..1), dist_floor=Slider(0.8, range=0..1), quad_only=Toggle(False))  # -> grid, points, mesh; plug-in component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
assigngridsviews = HBAssignGridsAndViews(model=model.model, grids=flatten(gridrooms.grid))  # -> model; plug-in component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

# ----
# x
# If the link below doesn't work
# (it needs internet)
# you can use a EPW file saved
# in your computer.
# 
# Right click - Select one existing file
# 
# Connect it to the ImportEPW component
# IMPORT EPW
panel_15 = Panel("https://energyplus-weather.s3.amazonaws.com/southwest_pacific_wmo_region_5/AUS/AUS_SA.Adelaide-Kent.Town.946750_RMY/AUS_SA.Adelaide-Kent.Town.946750_RMY.zip")
downloadepw = LBDownloadWeather(weather_URL=panel_15)  # -> epw_file, stat_file, ddy_file; plug-in component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
epw_file = FilePath()
# ENERGY USE, THERMAL COMFORT
# ANNUAL DAYLIGHT SIMULATION
importepw = LBImportEPW(epw_file=downloadepw.epw_file)  # -> location, dry_bulb_temperature, dew_point_temperature, relative_humidity, wind_speed, wind_direction, direct_normal_rad, diffuse_horizontal_rad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; plug-in component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
importstat = LBImportSTAT(stat_file=downloadepw.stat_file)  # -> location, ashrae_zone, koppen_zone, clear_dir_norm_rad, clear_diff_horiz_rad, ann_heat_dday_996, ann_heat_dday_990, ann_cool_dday_004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; plug-in component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

wea = HBWeaFromEPW(epw_file=downloadepw.epw_file)  # -> wea; plug-in component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

# ----
# Choose the hour of the year
# for the point in time
# illuminance simulation
number_slider_2 = Slider(2, range=1..12)
# *DON'T FORGET TO SET ALL THE SIMULATIONS TO
# FALSE BEFORE SAVING AND CLOSING YOUR FILE
# x
number_slider_3 = Slider(9, range=1..24)
climatebased = HBClimatebasedSky(wea=wea, month=number_slider_2, day=Slider(12, range=1..30), hour=number_slider_3)  # -> sky; plug-in component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

# ----
# You can change the analysis period
# to simulate summer and winter
# separately
number_slider_4 = Slider(2, range=1..12)
analysisperiod = LBAnalysisPeriod(start_month=Slider(11, range=1..12), start_day=1, start_hour=0, end_month=number_slider_4)  # -> period, hoys, dates; plug-in component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

extreme_cold_week = Data(importstat.extreme_cold_week)
extreme_hot_week = Data(importstat.extreme_hot_week)
analysis_run_period = Data(analysisperiod.period)

# ----
# 1
# SET TO TRUE TO RUN
# ENERGY USE SIMULATIUON
toggle_2 = BooleanToggle(False)

# ----
# 2
# SET TO TRUE TO RUN
# AND PLOT OPERATIVE TEMPERATURES
toggle_3 = BooleanToggle(False)

# ----
# SET TO TRUE TO RUN
# THERMAL COMFORT SIMULATIUON
# 3
toggle_4 = BooleanToggle(False)

# ----
# 4
# SET TO TRUE TO RUN
# ANNUAL DAYLIGHT SIMULATION
toggle_5 = BooleanToggle(False)

# ----
# 5
# SET TO TRUE TO RUN
# POINT-IN-TIME ILLUMINANCE
# SIMULATION
toggle_6 = BooleanToggle(False)

# ----
# 6
# SET TO TRUE TO RUN
# GLARE AUTONOMY SIMULATION
toggle_7 = BooleanToggle(False)

adaptivemap = HBAdaptiveComfortMap(model=assigngridsviews, epw=downloadepw.epw_file, ddy=downloadepw.ddy_file, run_period=analysis_run_period, run=toggle_4)  # -> report, env_conds, op_temp, condition, deg_neut, TCP, HSP, CSP; plug-in component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
annualloads = HBAnnualLoads(
    rooms=flatten(floorheight.rooms),
    shades=flatten([shade.shades, shade_2.shades]),
    epw_file=downloadepw.epw_file,
    timestep="4",
    run=toggle_2)  # -> report, total_load, cooling, heating, lighting, equip, process, hot_water, balance; plug-in component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
cluster = Cluster_2(
    model=model.model,
    epw_file=downloadepw.epw_file,
    epw_file_2=downloadepw.epw_file,
    run_period=analysis_run_period,
    run=toggle_3)
annualglare = HBImagelessAnnualGlare(model=assigngridsviews, wea=wea, run=toggle_7)  # -> report, results, GA; plug-in component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
annualdaylight = HBAnnualDaylight(model=assigngridsviews, wea=wea, run=toggle_5)  # -> report, results, DA, cDA, UDI, UDI_low, UDI_up; plug-in component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
pitgrid = HBPointInTimeGridBased(model=assigngridsviews, sky=climatebased, metric="0", run=toggle_6)  # -> report, results; plug-in component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

operative_temperature = Data(adaptivemap.op_temp)
thermal_condition = Data(adaptivemap.condition)

# ----
# DAYLIGHT AUTONOMY
# Daylight autonomy results in percent.
# DA is the percentage of occupied hour
# that each sensor recieves equal or more
# than the illuminance threshold.
number_slider_5 = Slider(3, range=0..26)
colrange = LBColorRange(index=number_slider_5)  # -> colors; plug-in component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
legendpar = LBLegendParameters(min="0", max="100", colors=colrange)  # -> leg_par; plug-in component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
daylightmetrics = HBAnnualDaylightMetrics(results=annualdaylight.results)  # -> report, DA, cDA, UDI, UDI_low, UDI_up; plug-in component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
mjoin = MeshJoin(Meshes=gridrooms.mesh)
heatmap = LBSpatialHeatmap(values=flatten(daylightmetrics.DA), mesh=mjoin, legend_par=legendpar, legend_title="%")  # -> mesh, legend, title, colors, legend_par, vis_set; plug-in component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

# ----
# POINT IN TIME ILLUMINANCE
number_slider_6 = Slider(3, range=0..26)
colrange_2 = LBColorRange(index=number_slider_6)  # -> colors; plug-in component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
legendpar_2 = LBLegendParameters(min="300", max="3000", colors=colrange_2)  # -> leg_par; plug-in component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
mjoin_2 = MeshJoin(Meshes=gridrooms.mesh)
heatmap_2 = LBSpatialHeatmap(values=flatten(pitgrid.results), mesh=mjoin_2, legend_par=legendpar_2)  # -> mesh, legend, title, colors, legend_par, vis_set; plug-in component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

# ----
# Minimun and Maximun
# Comfortable Temperature
number_slider_7 = Slider(18, range=0..100)

# ----
# Analysed floor
# Wireframes
vizwiref = HBVisualizeWireframe(hb_objs=flatten(branch))  # -> geo; plug-in component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

# ----
# Whole building
# Wireframes
vizwiref_2 = HBVisualizeWireframe(hb_objs=flatten(floorheight.rooms))  # -> geo; plug-in component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

# ----
# Shades
# Wireframes
vizwiref_3 = HBVisualizeWireframe(hb_objs=flatten(shade_2.shades))  # -> geo; plug-in component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

# ----
# GLARE AUTONOMY
# Glare autonomy results in percent.
# GA is the percentage of occupied hours
# that each sensor is free of glare according
# to the glare threshold.
# x
number_slider_8 = Slider(6, range=0..26)
colrange_3 = LBColorRange(index=number_slider_8)  # -> colors; plug-in component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
glaremetrics = HBAnnualGlareMetrics(results=annualglare.results)  # -> report, GA, sGA, pass_fail; plug-in component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
legendpar_3 = LBLegendParameters(min="0", max="100", colors=colrange_3)  # -> leg_par; plug-in component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
mjoin_3 = MeshJoin(Meshes=gridrooms.mesh)
heatmap_3 = LBSpatialHeatmap(values=flatten(glaremetrics.GA), mesh=mjoin_3, legend_par=legendpar_3, legend_title="%")  # -> mesh, legend, title, colors, legend_par, vis_set; plug-in component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

# ----
# Legend Limits
number_slider_9 = Slider(5, range=0..100)

min_max_line_colour = Data(ColourSwatch(SwatchColor=RGB(76, 76, 76)))
# x
number_slider_10 = Slider(0.1, range=0..1)
out_temp_colour = Data(ColourSwatch(SwatchColor=RGB(60, 103, 189)))
op_temp_colour = Data(ColourSwatch(SwatchColor=RGB(207, 58, 58)))
temp_text_size = Data(Slider(1.6, range=0..10))
text_colour = Data(ColourSwatch(SwatchColor=RGB(0, 0, 0)))
chart_lines = Data(ColourSwatch(SwatchColor=RGB(0, 0, 0)))
text_size = Data(Slider(2.6, range=0..10))
cluster_2 = Cluster(
    outdoor_temp=importepw.dry_bulb_temperature,
    analysis_period=analysis_run_period,
    op_temp_data=cluster,
    rooms_analysis=branch,
    x_scale=number_slider_10,
    min_comf_temp=number_slider_7,
    max_comf_temp=Slider(26, range=0..100),
    min_legend=number_slider_9,
    max_legend=Slider(45, range=0..100))  # -> out_temp_line_2, op_temp_line_2, chart_lines_2, min_max_line_2, y_axis_2, room_loc_2, room_text_2, month_loc_2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

heating_loads = Data(annualloads.heating)
# VISUALISE THE RESULTS
cooling_loads = Data(annualloads.cooling)

preview = CustomPreview(Geometry=vizwiref, Material=ColourSwatch(SwatchColor=RGB(0, 0, 0)))
preview_2 = CustomPreview(Geometry=vizwiref_2, Material=ColourSwatch(SwatchColor=RGB(0, 0, 0)))
preview_3 = CustomPreview(Geometry=vizwiref_3, Material=ColourSwatch(SwatchColor=RGB(0, 0, 0)))

# ----
# ENERGY USE BAR CHART
panel_16 = Panel("Total loads (kWh/m2)")
pt = Point(Point(13.69213553, -87.36818042, 0))
monthlychart = LBMonthlyChart(data=flatten(cooling_loads), base_pt=pt, y_axis_title=panel_16)  # -> report, data_mesh, data_lines, col_lines, legend, borders, labels, y_title, title, vis_set; plug-in component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
preview_4 = CustomPreview(
    Geometry=[monthlychart.data_lines, monthlychart.legend, monthlychart.borders, monthlychart.y_title, monthlychart.title, monthlychart.labels],
    Material=ColourSwatch(SwatchColor=RGB(0, 0, 0)))

of_time_comfortable = Data(cluster_2.op_temp_comf_2)
of_time_too_cold = Data(cluster_2.op_temp_too_cold_2)
of_time_too_hot = Data(cluster_2.op_temp_too_hot_2)

# ----
# THERMAL COMFORT PERCENTAGE
number_slider_11 = Slider(0.3, range=0..1)
text_location = Data(Slider(0.5, range=0..10))
text_size_2 = Data(Slider(0.3, range=0..1))
labelrooms = HBLabelRooms(rooms_model=flatten(branch), txt_height=number_slider_11)  # -> label_text, base_pts, labels, wire_frame; plug-in component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
Y = UnitY(Factor=text_location)
move = Move(Geometry=labelrooms.base_pts, Motion=Y)  # -> Geometry, Transform
colrange_4 = LBColorRange(index=Slider(12, range=0..26))  # -> colors; plug-in component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
legendpar_4 = LBLegendParameters(colors=colrange_4)  # -> leg_par; plug-in component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
mjoin_4 = MeshJoin(Meshes=gridrooms.mesh)
cluster_3 = Cluster_3(T=of_time_too_hot, L=gridrooms.points)
heatmap_4 = LBSpatialHeatmap(values=flatten(cluster_3), mesh=mjoin_4, legend_par=legendpar_4)  # -> mesh, legend, title, colors, legend_par, vis_set; plug-in component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

# ----
# Legend minimun and maximum
# temperature values
# 
# *Disconnect for
# Thermal Condition resuts
panel_17 = Panel("18")

# ----
# THERMAL COMFORT MAP
toggle_8 = BooleanToggle(True)
thermalmtx = HBReadThermalMatrix(comf_result=operative_temperature, load=toggle_8)  # -> comf_mtx; plug-in component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
use_this_for_the_entyre_year_simulation = Slider(1538, range=0..8759)
use_this_for_extreme_week_simulation = Slider(145, range=0..167)
legendpar_5 = LBLegendParameters(min=panel_17, max="28")  # -> leg_par; plug-in component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
# You might need to disable the preview
# of this component to not overlap with
# other visualisations
# 
# * Click on it with the scroll button
# select the face with a mask to disable
# or a face without a mask to enable the preview
vizthermalmap = HBVisualizeThermalMap(comf_mtx=thermalmtx, mesh=flatten(gridrooms.mesh), sim_step=use_this_for_extreme_week_simulation, legend_par=legendpar_5)  # -> report, mesh, legend, title, colors, values; plug-in component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

# ---- group: Reverse the colours
rev = ReverseList(List=colrange_4)

# ----
preview_5 = CustomPreview(Geometry=cluster_2.out_temp_line_2, Material=out_temp_colour)
preview_6 = CustomPreview(Geometry=cluster_2.op_temp_line_2, Material=op_temp_colour)
preview_7 = CustomPreview(Geometry=cluster_2.chart_lines_2, Material=chart_lines)
preview_8 = CustomPreview(Geometry=cluster_2.min_max_line_2, Material=min_max_line_colour)
# Visualise the Operative Temperature plots
tag = TextTag3D(Location=cluster_2.y_axis_2, Text="Op Temperature C", Size=text_size, Colour=text_colour, Justification=5)
tag_2 = TextTag3D(Location=cluster_2.room_loc_2, Text=cluster_2.room_text_2, Size=text_size, Colour=text_colour, Justification=5)
tag_3 = TextTag3D(Location=cluster_2.month_loc_2, Text=cluster_2.month_text_2, Size=text_size, Colour=text_colour, Justification=5)
tag_4 = TextTag3D(Location=cluster_2.temp_pts_2, Text=cluster_2.temp_text_2, Size=temp_text_size, Colour=text_colour, Justification=6)

room_label = Geometry(labelrooms.labels)
# You might need to disable the preview
# of these component to not overlap with
# other visualisations
# 
# * Click on it with the scroll button
# select the face with a mask to disable
# or a face without a mask to enable the preview
tag_5 = TextTag3D(
    Location=move.Geometry,
    Text=of_time_too_hot,
    Size=text_size_2,
    Colour=ColourSwatch(SwatchColor=RGB(0, 0, 0)),
    Justification=7)

# ==== cluster Cluster
rooms_analysis = ClusterInput()
max_comf_temp = ClusterInput()
min_comf_temp = ClusterInput()
analysis_period = ClusterInput()
outdoor_temp = ClusterInput()
op_temp_data = ClusterInput()
max_legend = ClusterInput()
min_legend = ClusterInput()
x_scale = ClusterInput()

rooms_analysis_2 = Data(rooms_analysis)
max_comf_temp_2 = Data(max_comf_temp)
min_comf_temp_2 = Data(min_comf_temp)
analysis_period_2 = Data(analysis_period)
outdoor_temp_2 = Data(outdoor_temp)
op_temp_data_2 = Data(op_temp_data)
max_legend_2 = Data(max_legend)
min_legend_2 = Data(min_legend)
x_scale_2 = Data(x_scale)
labelrooms = HBLabelRooms(rooms_model=flatten(rooms_analysis_2))  # -> label_text, base_pts, labels, wire_frame; plug-in component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
xdata = LBDeconstructData(data=op_temp_data_2)  # -> simplify(header), simplify(values); plug-in component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
case = TextCase(Text=labelrooms.label_text, Culture=127)  # -> UpperCase, LowerCase
concat = Concatenate(FragmentA="(", FragmentB=case.UpperCase, FragmentC=")")
tmatch = MatchText(Text=graft(xdata.header), RegEx=concat, Case=False)
ma = MassAddition(Input=tmatch)  # -> Result, PartialResults
cull = CullPattern(List=xdata.header, CullPattern=flatten(ma.Result))
cull_2 = CullPattern(List=xdata.values, CullPattern=ma.Result)
applyper = LBApplyAnalysisPeriod(data=outdoor_temp_2, period=analysis_period_2)  # -> data; plug-in component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
clean = CleanTree(RemoveNulls=True, RemoveInvalid=True, RemoveEmpty=True, Tree=cull_2)
op_temp_values = Data(simplify(clean))
xdata_2 = LBDeconstructData(data=applyper)  # -> header, values; plug-in component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
tstat = TreeStatistics(Tree=op_temp_values)  # -> Paths, Length, Count
tstat_2 = TreeStatistics(Tree=xdata_2.values)  # -> Paths, Length, Count
addition = Addition(A=max_legend_2, B="20")
series = Series(Start=0, Step=x_scale_2, Count=tstat.Length)
lng = ListLength(List=tstat.Length)
series_2 = Series(Start=0, Step=x_scale_2, Count=tstat_2.Length)
series_3 = Series(Start=0, Step=addition, Count=lng)  # -> graft(Series)
pt = ConstructPoint(XCoordinate=series, YCoordinate=op_temp_values, ZCoordinate=0)
pt_2 = ConstructPoint(XCoordinate=series_2, YCoordinate=xdata_2.values, ZCoordinate=0)
Y = UnitY(Factor=series_3)
bbox = BoundingBox(Content=flatten(pt), Plane=PlaneXY(0, 0, 0), UnionBox=True)  # -> Box, Box_2
datadt = LBDataDateTimes(data=op_temp_data_2)  # -> simplify(hoys); plug-in component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
pline = PolyLine(Vertices=pt_2, Closed=False)
debox = DeconstructBox(Box=bbox.Box)  # -> Plane, X, Y, Z
rec = Rectangle(bbox.Box)
move = Move(Geometry=rec, Motion=Y)  # -> Geometry, Transform
dedomain = DeconstructDomain(Domain=debox.X)  # -> Start, End
dom = ConstructDomain(DomainStart=min_legend_2, DomainEnd=max_legend_2)
rectangle = Rectangle(Plane=PlaneXY(0, 0, 0), XSize=dedomain.End, YSize=dom, Radius=0)  # -> Rectangle, Length
branch = TreeBranch(Tree=datadt, Path=Slider(0, range=0..100), MaintainPaths=True)
recmap = RectangleMapping(Geometry=pt, Source=rec, Target=move.Geometry)  # -> Geometry, Transform
datetime = LBHOYToDateTime(hoy=simplify(branch))  # -> month, day, hour, minute, date; plug-in component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
range = Range(Domain=dom, Steps=Slider(10, range=0..10))
move_2 = Move(Geometry=rectangle.Rectangle, Motion=Y)  # -> Geometry, Transform
panel = Panel(""":
 """)
lng_2 = ListLength(List=range)
split = TextSplit(Text=cull, Separators=panel)  # -> simplify(Result)
explode = Explode(Curve=move_2.Geometry, Recursive=True)  # -> Segments, Vertices
split_2 = TextSplit(Text=datetime.date, Separators=" ")
tstat_3 = TreeStatistics(Tree=op_temp_values)  # -> Paths, Length, Count
item = ListItem(List=split_2, Index=0, Wrap=True)  # -> Item, flatten(Item1)
item_2 = ListItem(List=split, Index="12", Wrap=True)
item_3 = ListItem(List=tstat_3.Length, Index=0, Wrap=True)
roundd = RoundToDecimalPlace(NumberX=range, DecimalPlace=Slider(1, range=0..10), RoundType=0)  # -> Rounded, Difference
item_4 = ListItem(List=explode.Segments, Index="0", Wrap=True)  # -> Item, Item1, Item2
item_5 = ListItem(List=explode.Segments, Index="3", Wrap=True)
dcon = DeleteConsecutive(Set=item.Item1, Wrap=False)  # -> Set, Count
division = Division(A=item_3, B="720")
split_3 = TextSplit(Text=item_2, Separators="_")  # -> simplify(Result)
lng_3 = ListLength(List=dcon.Set)
divide = DivideCurve(Curve=item_5, Count=expr("x-1", lng_2), Kinks=False)  # -> reverse(Points), Tangents, Parameters
pt_3 = ConstructPoint(XCoordinate=0, YCoordinate=max_comf_temp_2, ZCoordinate=0)
pt_4 = ConstructPoint(XCoordinate=0, YCoordinate=min_comf_temp_2, ZCoordinate=0)
divide_2 = DivideCurve(Curve=item_4.Item2, Count=division, Kinks=False)  # -> Points, Tangents, Parameters
divide_3 = DivideCurve(Curve=item_4.Item, Count=division, Kinks=False)  # -> Points, Tangents, Parameters
divide_4 = DivideCurve(Curve=item_4.Item, Count=expr("x*2", lng_3), Kinks=False)  # -> Points, Tangents, Parameters
item_6 = ListItem(List=split_3, Index=0, Wrap=True)  # -> Item, Item1
panel_2 = Panel("""False
True""")
X = UnitX(Factor=1)
X_2 = UnitX(Factor=1)
curvepoint = PointOnCurve(item_5, parameter=0.5)
X_3 = UnitX(Factor=expr("-x", Slider(8, range=0..10)))
cull_3 = CullPattern(List=divide_4.Points, CullPattern=panel_2)
X_4 = UnitX(Factor=expr("-x", Slider(0.9, range=0..1)))
line = LineSDL(Start=pt_3, Direction=X, Length=dedomain.End)
Y_2 = UnitY(Factor=expr("-x", Slider(6, range=0..10)))
line_2 = LineSDL(Start=pt_4, Direction=X_2, Length=dedomain.End)
split_4 = TextSplit(Text=analysis_period_2, Separators=" ")
move_3 = Move(Geometry=curvepoint, Motion=X_3)  # -> Geometry, Transform
curvepoint_2 = PointOnCurve(item_4.Item2, parameter=0.5)
Y_3 = UnitY(Factor=Slider(6, range=0..10))
merge = Merge(Data1=line_2, Data2=line)
ln = Line(StartPoint=divide_3.Points, EndPoint=reverse(divide_2.Points))
pline_2 = PolyLine(Vertices=recmap.Geometry, Closed=False)
move_4 = Move(Geometry=divide.Points, Motion=X_4)  # -> Geometry, Transform
move_5 = Move(Geometry=cull_3, Motion=Y_2)  # -> Geometry, Transform
xy = XYPlane(Origin=move_3.Geometry)
move_6 = Move(Geometry=pline, Motion=Y)  # -> Geometry, Transform
item_7 = ListItem(List=split_4, Index=0, Wrap=True)  # -> Item, Item1, Item2
move_7 = Move(Geometry=curvepoint_2, Motion=Y_3)  # -> Geometry, Transform
prot = RotatePlane(Plane=xy, Angle=degrees("90"))
move_8 = Move(Geometry=merge, Motion=Y)  # -> Geometry, Transform
concat_2 = Concatenate(
    FragmentA=item_6.Item,
    FragmentI=" ",
    FragmentJ=item_6.Item1,
    FragmentH=":",
    FragmentB=" ",
    FragmentC=item_7.Item,
    FragmentD=" ",
    FragmentE=item_7.Item1,
    FragmentF=" ",
    FragmentG=item_7.Item2)
X_5 = UnitX(Factor=1)
line_3 = LineSDL(Start=move_4.Geometry, Direction=X_5, Length=Slider(1, range=0..10))
out_temp_line = Data(move_6.Geometry)
op_temp_line = Data(pline_2)
min_max_line = Data(move_8.Geometry)
month_text = Data(dcon.Set)
room_text = Data(concat_2)
temp_text = Data(roundd.Rounded)
month_loc = Data(move_5.Geometry)
room_loc = Data(move_7.Geometry)
temp_pts = Data(move_4.Geometry)
y_axis = Data(prot)

lng_4 = ListLength(List=op_temp_values)
larger = LargerThan(FirstNumber=op_temp_values, SecondNumber=max_comf_temp_2)  # -> LargerThan, OrEqualTo
smaller = SmallerThan(FirstNumber=op_temp_values, SecondNumber=min_comf_temp_2)  # -> SmallerThan, OrEqualTo
expression = Expression(x=op_temp_values, y=max_comf_temp_2, z=min_comf_temp_2, Expression="if((x<y) and (x>z),1,0)")
abs = Absolute(Value=smaller.SmallerThan)
abs_2 = Absolute(Value=larger.LargerThan)
ma_2 = MassAddition(Input=abs_2)  # -> Result, PartialResults
ma_3 = MassAddition(Input=expression)  # -> Result, PartialResults
ma_4 = MassAddition(Input=abs)  # -> Result, PartialResults
division_2 = Division(A=ma_2.Result, B=lng_4)
division_3 = Division(A=ma_3.Result, B=lng_4)
division_4 = Division(A=ma_4.Result, B=lng_4)
multiplication = Multiplication(A=division_3, B="100")
multiplication_2 = Multiplication(A=division_2, B="100")
multiplication_3 = Multiplication(A=division_4, B="100")
roundd_2 = RoundToDecimalPlace(NumberX=multiplication, DecimalPlace="2", RoundType=0)  # -> Rounded, Difference
roundd_3 = RoundToDecimalPlace(NumberX=multiplication_2, DecimalPlace="2", RoundType=0)  # -> Rounded, Difference
roundd_4 = RoundToDecimalPlace(NumberX=multiplication_3, DecimalPlace="2", RoundType=0)  # -> Rounded, Difference
concat_3 = Concatenate(FragmentA=roundd_2.Rounded, FragmentB="%")
concat_4 = Concatenate(FragmentA=roundd_3.Rounded, FragmentB="%")
concat_5 = Concatenate(FragmentA=roundd_4.Rounded, FragmentB="%")

merge_2 = Merge(Data1=simplify(move_2.Geometry), Data2=simplify(ln), Data3=simplify(line_3))

sort = SortList(Keys=flatten(item_6.Item1), ValuesA=flatten(concat_4))  # -> Keys, ValuesA
sort_2 = SortList(Keys=flatten(item_6.Item1), ValuesA=flatten(concat_3))  # -> Keys, ValuesA
sort_3 = SortList(Keys=flatten(item_6.Item1), ValuesA=flatten(concat_5))  # -> Keys, ValuesA
op_temp_too_cold = Data(sort_3.ValuesA)
op_temp_too_hot = Data(sort.ValuesA)
op_temp_comf = Data(sort_2.ValuesA)
chart_lines = Geometry(merge_2)

op_temp_too_cold_2 = ClusterOutput(op_temp_too_cold)
op_temp_too_hot_2 = ClusterOutput(op_temp_too_hot)
op_temp_comf_2 = ClusterOutput(op_temp_comf)
out_temp_line_2 = ClusterOutput(out_temp_line)
op_temp_line_2 = ClusterOutput(op_temp_line)
min_max_line_2 = ClusterOutput(min_max_line)
month_text_2 = ClusterOutput(month_text)
room_text_2 = ClusterOutput(room_text)
temp_text_2 = ClusterOutput(temp_text)
chart_lines_2 = ClusterOutput(chart_lines)
month_loc_2 = ClusterOutput(month_loc)
room_loc_2 = ClusterOutput(room_loc)
temp_pts_2 = ClusterOutput(temp_pts)
y_axis_2 = ClusterOutput(y_axis)

# ==== cluster Cluster_2
toggle = BooleanToggle(False)
simoutput = HBSimulationOutput(
    zone_energy_use=toggle,
    hvac_energy_use=toggle,
    comfort_metrics=Toggle(True),
    surface_temperature=toggle,
    surface_energy_flow=toggle)  # -> report, sim_output; plug-in component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
run_period = ClusterInput()
simpar = HBSimulationParameter(output=simoutput.sim_output, run_period=run_period, timestep=6)  # -> sim_par; plug-in component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
model = ClusterInput()
epw_file = ClusterInput()
run = ClusterInput()
modeltoosm = HBModelToOSM(model=model, epw_file=epw_file, sim_par=simpar, write=Toggle(True), run=run)  # -> report, jsons, osw, osm, idf, sql, zsz, rdd, html; plug-in component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
epw_file_2 = ClusterInput()
runosm = HBRunOSM(osm=modeltoosm.osm, epw_file=epw_file_2, translate=Toggle(True), run=Toggle(True))  # -> report, idf, sql, zsz, rdd, html; plug-in component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
roomcomfortresult = HBReadRoomComfortResult(sql=runosm.sql)  # -> oper_temp, air_temp, rad_temp, rel_humidity; plug-in component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
oper_temp = ClusterOutput(roomcomfortresult.oper_temp)

# ==== cluster Cluster_3
L = ClusterInput()
lng = ListLength(List=L)
T = ClusterInput()
split = TextSplit(Text=T, Separators="%")
item = ListItem(List=split, Index=0, Wrap=True)
repeat = RepeatData(Data=item, Length=lng)
D = ClusterOutput(repeat)
